# Grasshopper definition 250218_GHScript_Karamba3d_STB Platte-1.gh (Grasshopper 1.0.7)
# plug-ins: Karamba3D, Speckle 2, Heteroptera, Hops

panel = Panel("791d494b2e")  # disabled
list = Accounts(
    {"No account selected": , "Account (denitsastefanova285@gmail.com | https://app.speckle.systems)": "https://app.speckle.systems/?id=79d7e4a907"}, selected="Account (denitsastefanova285@gmail.com | https://app.speckle.systems)",
    FirstSelectedItem="https://app.speckle.systems/?id=79d7e4a907")
panel_2 = Panel("https://app.speckle.systems/projects/791d494b2e/models/f625851327")
sr = SynchronousReceiver(
    Stream=panel_2,
    AutoReceive=False,
    KitName="Objects",
    ReceivedObjectId="356c344ecf93b7d157edd9d120c8e00a",
    StreamWrapper="https://app.speckle.systems/projects/791d494b2e/models/f625851327",
    selectedKitName="Objects")  # -> Data, Info
dso = DeconstructSpeckleObject(SpeckleObject=sr.Data, selectedKitName="Objects")  # -> Data, Key, Member, Utilization
python = GhPythonScript()  # -> out, a; disabled
# ---------- python: Python ----------
__author__ = "Denitsa"
__version__ = "2025.02.11"

import rhinoscriptsyntax as rs
import Rhino
import scriptcontext as sc

def save_gh():
    # Ensure we are in the Grasshopper document context
    if sc.doc is None:
        print("❌ No active Grasshopper document found.")
        return

    # Get the path of the currently open Grasshopper file
    gh_file = sc.doc.Path
    if not gh_file:
        print("❌ Grasshopper file has not been saved before. Save it manually first.")
        return

    # Create FileWriteOptions object (this is required in Rhino 6/7)
    options = Rhino.FileIO.FileWriteOptions()
    options.IncludePreviewImage = True  # Optional: include preview image
    options.SuppressDialogBoxes = True  # Prevent UI popups

    # Attempt to save the Grasshopper definition
    success = Rhino.RhinoDoc.ActiveDoc.WriteFile(gh_file, options)
    
    if success:
        print("✅ Grasshopper file saved: {}".format(gh_file))
    else:
        print("❌ Failed to save Grasshopper file.")

# Run the function
save_gh()
# ---------- end python ----------

thickness = Slider(26, range=10..50)
area = Slider(61, range=0..100)

panel_3 = Panel("C:\Users\Denitsa\Documents\WebSite\22.Video\250216_GHScript_Karamba3d_STB Platte-1.gh")
dso_2 = DeconstructSpeckleObject(SpeckleObject=dso.Data, selectedKitName="Objects")
panel_4 = Panel("(0)")  # disabled
panel_5 = Panel("(0)")  # disabled
python_2 = GhPythonScript()  # -> out, simplify(a), simplify(t); inputs members_data: list; disabled
# ---------- python_2: Python ----------
__author__ = "Denitsa"
__version__ = "2024.06.03"

"""Provides a scripting component.
    Inputs:
        x: The x script variable
        y: The y script variable
    Output:
        a: The a output variable"""

__author__ = "Denitsa"
__version__ = "2024.06.03"

"""Provides a scripting component.
    Inputs:
        x: The x script variable
        y: The y script variable
    Output:
        a: The a output variable"""

__author__ = "Denitsa"
__version__ = "2024.06.03"

"""Provides a scripting component.
    Inputs:
        x: The x script variable
        y: The y script variable
    Output:
        a: The a output variable"""

__author__ = "Denitsa"
__version__ = "2024.06.03"

"""Provides a scripting component.
    Inputs:
        x: The x script variable
        y: The y script variable
    Output:
        a: The a output variable"""

__author__ = "Denitsa"
__version__ = "2024.06.03"

import rhinoscriptsyntax as rs
import ghpythonlib.treehelpers as th
    
def get_member_properties(member_obj):
    """Retrieve area and thickness from a Speckle 'Member' object."""
    area = getattr(member_obj, 'area', None)
    thickness = getattr(member_obj, 'thickness', None)
    return area, thickness

# 'members_data' is your directly connected list

if isinstance(members_data, list):
    for item in members_data:
        # Access the 'Member' object within each element
        member_obj = getattr(item, "Member", None)
        if member_obj is not None:
            area, thickness = get_member_properties(member_obj)
            print("Area: {}, Thickness: {}".format(area, thickness))
        else:
            print("Member object not found in this element.")
else:
    print("Error: '@{0;0}' branch is not a list or doesn't exist.")
a = area
t = thickness
# ---------- end python_2 ----------
number_slider = Slider(3, range=0..10)
number_slider_2 = Slider(4, range=0..10)

area_2 = GetNumber(area, AtLeast=1, AtMost=1, Maximum=1.797693135e+308, Minimum=-1.797693135e+308, TreeAccess=False)
thickness_2 = GetNumber(thickness, AtLeast=1, AtMost=1, Maximum=1.797693135e+308, Minimum=-1.797693135e+308, TreeAccess=False)

dso_3 = DeconstructSpeckleObject(SpeckleObject=dso_2, selectedKitName="Objects")
branch = TreeBranch(Tree=python_2.a, Path=panel_4, MaintainPaths=True)  # disabled
branch_2 = TreeBranch(Tree=python_2.t, Path=panel_5, MaintainPaths=True)  # disabled
sgat = GetAccountToken(SpeckleAccount=list)
panel_6 = Panel(python_2.t)  # disabled
panel_7 = Panel(dso_3)
hops = Hops(
    _Path=panel_3,
    _Enabled=Toggle(False),
    Project_url=panel_2,
    SPECKLE_TOKEN_APP=sgat,
    Area=61,
    Thickness=26,
    CacheResultsInMemory=True,
    CacheSolveResults=True,
    RemoteDefinitionLocation="C:\Users\Denitsa\Documents\WebSite\22.Video\250216_GHScript_Karamba3d_STB Platte-1.gh",
    RemoteSolveVersion=(0, 1, 0),
    ShowInput_Enabled=True,
    ShowInput_Path=True,
    SynchronousSolve=True)
division = Division(A=area_2, B=number_slider_2)
division_2 = Division(A=area_2, B=number_slider)
planesrf = PlaneSurface(Plane=PlaneXY(0, 0, 0), XSize=division, YSize=division_2)
Z = UnitZ(Factor=Slider(3, range=0..10))
panel_8 = Panel(hops)
sdivide = DivideSurface(Surface=planesrf, UCount=number_slider_2, VCount=number_slider)  # -> Points, Normals, Parameters
move = Move(Geometry=sdivide.Points, Motion=Z)  # -> Geometry, Transform
move_2 = Move(Geometry=planesrf, Motion=Z)  # -> Geometry, Transform
number_slider_3 = Slider(30, range=10..50)
mesh_breps = MeshBrepsKaramba3D(
    Brep=move_2.Geometry,
    InclusionPoints=flatten(move.Geometry),
    MeshResolution=Slider(0.221, range=0..1),
    EdgeRefinementFactor=0.67,
    PointReduction=False,
    SmoothingStepSize=0,
    SmoothingIterations=5)  # -> Mesh, Info
matselect = MaterialSelectionKaramba3D(menu=[dropdown(7), dropdown(6)])
matselect_2 = MaterialSelectionKaramba3D(menu=[dropdown(7), dropdown(6)])
ln = Line(StartPoint=sdivide.Points, EndPoint=move.Geometry)
debrep = DeconstructBrep(Brep=move_2.Geometry)  # -> Faces, Edges, Vertices

item = ListItem(List=debrep.Edges, Index=0, Wrap=True)  # -> Item, Item1, Item2, Item3
geo = Geometry(item.Item)
neg = Negative(Value=Slider(0, range=0..10))
offset = OffsetCurve(Curve=geo, Distance=neg, Corners=1)

panel_9 = Panel("""7.5
1.5
5""")
crosec = CrossSectionKaramba3D(
    FamilyNameOfCrossSection="DefaultCroSec",
    Material=matselect,
    Height_cm=number_slider_3,
    UpperFlangeWidth_cm=number_slider_3,
    LowerFlangeWidth_cm=number_slider_3,
    mode="Trapezoid")
crosec_2 = CrossSectionKaramba3D(FamilyNameOfCrossSection="DefaultCroSec", Material=matselect_2, Height_cm=thickness_2, mode="Shell - Const")
neg_2 = Negative(Value=panel_9)
panel_10 = Panel("""gk1
gk2
qk""")
lccombinator = LoadCaseCombinatorKaramba3D(LoadCaseCombinationRulesKaramba3D="A = 1.35 * (gk1 + gk2) + 1.5 * qk")  # -> LoadCaseCombinations, NamesOfLoadCases, NumberOfLoadCases
Z_2 = UnitZ(Factor=neg_2)
supp = SupportKaramba3D(PosInd=sdivide.Points, menu=[buttons(on, on, on, on, on, on)])
lineelem = CreateLinearElementKaramba3D(
    Line=ln,
    CrossSection=crosec,
    LimitDistance_m=0.005,
    BucklingLengthY_m=-1,
    BucklingLengthZ_m=-1,
    BucklingLengthLT_m=-1,
    Bending=True,
    ToPolylineMaxAngle=0.03,
    ToPolylineTolerance=0.01,
    ToPolylineMaxEdgeLength=0.25,
    New=True,
    Remove=True,
    mode="LineToBeam")  # -> Element, Points, Info
surfelem = CreateSurfaceElementKaramba3D(Mesh=mesh_breps.Mesh, CrossSection=crosec_2, LimitDistance_m=0.005, Bending=True, mode="MeshToShell")  # -> Element, Points, Info
entwine = Entwine(Branch00=surfelem.Element, Branch01=lineelem.Element, FlattenInputs=True)
lng = ListLength(List=entwine)
series = Series(Start=1, Step=1, Count=lng)
panel_11 = Panel("""PL
C""")
pshift = ShiftPaths(Data=series, Offset=-1)
concat = Concatenate(FragmentA=graft(panel_11), FragmentB=pshift)
panel_12 = Panel(concat)
branch_3 = TreeBranch(Tree=panel_12, Path="0;0", MaintainPaths=True)
loads = LoadsKaramba3D(
    Vector=Z_2,
    Mesh=mesh_breps.Mesh,
    ElementIdentifiers=branch_3,
    LCase=panel_10,
    mode="MeshLoad -Const.",
    menu=[buttons(off, on, off), buttons(on, off)])
assemble = AssembleModelKaramba3D(
    Elem=flatten([lineelem.Element, surfelem.Element]),
    Support=flatten(supp),
    Load=flatten([loads, lccombinator.LoadCaseCombinations]),
    LimitDistance_m=0.005)  # -> Model, Info, Mass_kg, CentreOfGravity, LoadCaseNames
panel_13 = Panel(assemble.LoadCaseNames)
analyse = AnalyseKaramba3D(Model=assemble.Model)  # -> AnalysedModel, MaximumDisplacement_cm, ResultingForce_kN, ChangeOfElasticEnergy_kNm
panel_14 = Panel(analyse.MaximumDisplacement_cm)
modelview = ModelViewKaramba3D(Model=analyse.AnalysedModel)  # -> Model, DeformedMesh, DeformedAxes, DeformedModel, MaximumDeformation
shellview = ShellViewKaramba3D(Model=modelview.Model, IndexOfLayer=0)  # -> Model, MeshesOfRenderedShells, LegendColours, LegendTags
beamview = BeamViewKaramba3D(Model=modelview.Model)  # -> Model, MeshesOfRenderedBeams, DeformedBeamAxes, LegendColours, LegendTags
s_forces = ShellForcesKaramba3D(AnalysedModel=modelview.Model, mode="Principal")  # -> Model, FirstPrincipalNormalForce_kN_m, SecondPrincipalNormalForce_kN_m, FirstPrincipalMoment_kNm_m, SecondPrincipalMoment_kNm_m, ShearForceInLocalXDirection_kN_m, ShearForceInLocalYDirection_kN_m, LoadCaseIndex
disassemble = DisassembleModelKaramba3D(Model=shellview.Model)  # -> Model, Point, Beam, Shell, Support, Load, Line, Mesh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
conparts = ConnectedPartsKaramba3D(Model=analyse.AnalysedModel)  # -> ConnectedLines, ConnectedMeshes
s_forces_2 = ShellSectionKaramba3D(
    Model=shellview.Model,
    IntersectionGeometry=offset,
    ProjectionDirection=Vector(0, 0, -1),
    mode="Forces",
    menu=[checkbox(on), checkbox(on), checkbox(on), slider(12), slider(0.35), slider(0.19), checkbox(off), checkbox(off), checkbox(off), checkbox(off), checkbox(off), checkbox(off), checkbox(off), checkbox(off), checkbox(off), slider(0.64)])  # -> Model, CuttingCurves, FaceIndices, MeshesOfRenderedResults, CurvesOfRenderedResults, Ntt_kN_m, Nnn_kN_m, Ntn_kN_m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
speckle_token_app = GetString(AtLeast=1, AtMost=1, TreeAccess=False)
project_url = GetString(AtLeast=1, AtMost=1, TreeAccess=False)
entwine_2 = Entwine(Branch00=conparts.ConnectedMeshes, Branch01=conparts.ConnectedLines, FlattenInputs=True)
panel_15 = Panel("""area
thickness""")
merge = Merge(Data1=area_2, Data2=thickness_2)
bang = ExplodeTree(Data=entwine_2)  # -> Branch0, Branch1
panel_16 = Panel(s_forces_2.Mtt_kNm_m)
sgetwt = StreamGetWithToken(Stream=project_url, AuthToken=speckle_token_app)
utilization = UtilizationOfElementsKaramba3D(AnalysedModel=s_forces_2.Model, mode="Shells")  # -> Model, flatten(Utilization), LoadCaseIndex
esokv = ExtendSpeckleObjectByKeyValue(SpeckleObject=bang.Branch0, Keys=panel_15, Values=merge, selectedKitName="Objects")
cso = CreateSpeckleObject(Member=[esokv, bang.Branch1], Key=panel_12, selectedKitName="Objects")
extremes = MinMax(Number=utilization.Utilization)  # -> Minimum, Maximum
result = Number(extremes.Maximum)
csokv = CreateSpeckleObjectByKeyValue(Keys="Utilization", Values=result, selectedKitName="Objects")
ss = SynchronousSender(
    Data=[cso, csokv],
    Stream=sgetwt,
    OutputWrappers="https://app.speckle.systems\t791d494b2e\t7ee355374b",
    UseDefaultCache=True,
    selectedKitName="Objects")
panel_17 = Panel(cso)
dso_4 = DeconstructSpeckleObject(SpeckleObject=esokv, selectedKitName="Objects")  # -> flatten(Area), Bbox, Colors, Faces, TextureCoordinates, TextureCoordinatesCount, Thickness, Units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
send = Send(
    Members=cso,
    Utilization=extremes.Maximum,
    AutoSend=False,
    BaseId="00727950bb9ac994cc10cf5954895f71",
    CurrentComponentState="expired",
    KitName="Objects",
    OutputWrappers="https://app.speckle.systems\t791d494b2e\t8225b4386b",
    UseDefaultCache=True,
    selectedKitName="Objects")  # disabled
txt = Text(ss)
context_print = ContextPrint(Text=txt)
panel_18 = Panel(dso_4.Area)
ss_2 = SynchronousSender(
    Data=[cso, csokv],
    Stream=sgetwt,
    OutputWrappers="https://app.speckle.systems\t791d494b2e\t4c3854fc65",
    UseDefaultCache=True,
    selectedKitName="Objects")  # disabled
panel_19 = Panel(ss_2)
path = FilePath("C:\Users\Denitsa\Documents\WebSite\22.Video\CommitID.txt")
python_3 = GhPythonScript(y=path)  # -> out, a; disabled
# ---------- python_3: Python ----------
__author__ = "Denitsa"
__version__ = "2024.05.26"

import rhinoscriptsyntax as rs
import re


# Inputs
version_url = x  # The URL containing the commit ID
version_file_path = y  # Path to the file where commit ID will be saved

# Function to extract commit ID from URL
def extract_version_id(url):
    match = re.search(r'@([a-zA-Z0-9]+)', url)
    if match:
        return match.group(1)
    return None

# Extract commit ID
version_id = extract_version_id(version_url)

# Save commit ID to a file if found
if version_id:
    with open(version_file_path, 'w') as file:
        file.write(version_id)



# Output the commit ID (optional)
a = version_id
# ---------- end python_3 ----------
panel_20 = Panel(path)
panel_21 = Panel(python_3.a)
