# Grasshopper definition GHScript_Karamba3d_2d_Structures_Shell_22Video.gh (Grasshopper 1.0.7)
# plug-ins: Karamba3D, Speckle 2, Hops, Heteroptera

number_slider = Slider(17, range=0..100)

# ----
# Hops Check for Rhino.Compute
panel = Panel("C:\Users\Denitsa\Documents\WebSite\22.Video+SpeckleConf\GHScript_Karamba3d_2d Structures_Shell_22Video.gh")
hops = Hops(
    _Path=panel,
    _Enabled=Toggle(True),
    CacheResultsInMemory=True,
    CacheSolveResults=True,
    RemoteDefinitionLocation="C:\Users\Denitsa\Documents\WebSite\22.Video+SpeckleConf\GHScript_Karamba3d_2d Structures_Shell_22Video.gh",
    RemoteSolveVersion=(0, 1, 0),
    ShowInput_Enabled=True,
    ShowInput_Path=True,
    SynchronousSolve=True)

area = GetNumber(AtLeast=1, AtMost=1, Maximum=1.797693135e+308, Minimum=-1.797693135e+308, TreeAccess=False)
thickness = GetNumber(AtLeast=1, AtMost=1, Maximum=1.797693135e+308, Minimum=-1.797693135e+308, TreeAccess=False)

# ----
# Geometry
number_slider_2 = Slider(0.39, range=0..1)
sqrt = SquareRoot(Value=area)
multiplication = Multiplication(A=sqrt, B=number_slider_2)
division = Division(A=sqrt, B="2")
addition = Addition(A=division, B=multiplication)
division_2 = Division(A=area, B=addition)
rectangle = Rectangle(Plane=PlaneXY(0, 0, 0), XSize=division_2, YSize=addition, Radius=0)  # -> Rectangle, Length
debrep = DeconstructBrep(Brep=rectangle.Rectangle)  # -> Faces, Edges, Vertices
len = Length(Curve=debrep.Edges)
column_height = Slider(6, range=0..10)
Z = UnitZ(Factor=column_height)
move = Move(Geometry=debrep.Faces, Motion=Z)  # -> Geometry, Transform
debrep_2 = DeconstructBrep(Brep=move.Geometry)  # -> Faces, Edges, Vertices
offsets = OffsetOnSrf(Curve=debrep_2.Edges, Distance=Slider(0.6, range=0.1..0.8), Surface=debrep_2.Faces)  # -> flatten(Curve)
neg = Negative(Value=column_height)
area_2 = Area(Geometry=debrep_2.Faces)  # -> Area, Centroid
neg_2 = Negative(Value=column_height)
Z_2 = UnitZ(Factor=neg)
mcx = MultipleCurves(Curves=offsets)  # -> Points, IndexA, IndexB, ParamA, ParamB
Z_3 = UnitZ(Factor=neg_2)
move_2 = Move(Geometry=area_2.Centroid, Motion=Z_2)  # -> Geometry, Transform
move_3 = Move(Geometry=mcx.Points, Motion=Z_3)  # -> Geometry, Transform

# ----
# Karamba3D Setup
number_slider_3 = Slider(31, range=0..100)
matselect = MaterialSelectionKaramba3D(menu=[dropdown(7), dropdown(6)])
crosec = CrossSectionKaramba3D(FamilyNameOfCrossSection="DefaultCroSec", Material=matselect, Height_cm=thickness, mode="Shell - Const")
crosec_2 = CrossSectionKaramba3D(
    FamilyNameOfCrossSection="DefaultCroSec",
    Material=matselect,
    Height_cm=number_slider_3,
    UpperFlangeWidth_cm=number_slider_3,
    LowerFlangeWidth_cm=number_slider_3,
    mode="Trapezoid")
ln = Line(StartPoint=mcx.Points, EndPoint=move_3.Geometry)
ln_2 = Line(StartPoint=area_2.Centroid, EndPoint=move_2.Geometry)
expression = Expression(g=Slider(8.94, range=0..10), q=Slider(6.17, range=0..10), Expression="1.35*g + 1.5*q")
mesh_breps = MeshBrepsKaramba3D(
    Brep=debrep_2.Faces,
    InclusionPoints=mcx.Points,
    MeshResolution=1,
    EdgeRefinementFactor=0.67,
    PointReduction=False,
    SmoothingStepSize=0,
    SmoothingIterations=5)  # -> Mesh, Info
pt = Point(move_3.Geometry)
pt_2 = Point(move_2.Geometry)
neg_3 = Negative(Value=expression)
panel_2 = Panel("LC0")
Z_4 = UnitZ(Factor=neg_3)
loads = LoadsKaramba3D(Vector=Z_4, Mesh=mesh_breps.Mesh, LCase="LC0", mode="MeshLoad -Const.", menu=[buttons(on, off, off), buttons(on, on)])
supp = SupportKaramba3D(PosInd=flatten(pt), menu=[buttons(on, on, on, off, off, on)])
lineelem = CreateLinearElementKaramba3D(
    Line=flatten(ln),
    Identifier="Column",
    CrossSection=crosec_2,
    LimitDistance_m=0.005,
    BucklingLengthY_m=-1,
    BucklingLengthZ_m=-1,
    BucklingLengthLT_m=-1,
    Bending=True,
    ToPolylineMaxAngle=0.03,
    ToPolylineTolerance=0.01,
    ToPolylineMaxEdgeLength=0.25,
    New=True,
    Remove=True,
    mode="LineToBeam")  # -> Element, Points, Info
surfelem = CreateSurfaceElementKaramba3D(Mesh=mesh_breps.Mesh, Identifier="Shell", CrossSection=crosec, LimitDistance_m=0.005, mode="MeshToShell")  # -> Element, Points, Info

# ----
# Label Elements
entwine = Entwine(Branch00=surfelem.Element, Branch01=lineelem.Element, FlattenInputs=True)
lng = ListLength(List=entwine)
series = Series(Start=1, Step=1, Count=lng)
panel_3 = Panel("""PL
C""")
pshift = ShiftPaths(Data=series, Offset=-1)
concat = Concatenate(FragmentA=graft(panel_3), FragmentB=pshift)
panel_4 = Panel(concat)

item = ListItem(List=offsets, Index=0, Wrap=True)  # -> Item, Item1, Item2, Item3
geo = Geometry(item.Item)
neg_4 = Negative(Value=Slider(0, range=0..10))
offset = OffsetCurve(Curve=geo, Distance=1, Corners=1)

# ----
# Karamba3D Analysis
load = LoadKaramba3D(loads)
element = ElementKaramba3D([surfelem.Element, lineelem.Element])
support = SupportKaramba3D(supp)
assemble = AssembleModelKaramba3D(Elem=flatten(element), Support=flatten(support), Load=load, LimitDistance_m=0.005)  # -> Model, Info, Mass_kg, CentreOfGravity, LoadCaseNames
elemquery = ElementQueryKaramba3D(Model=assemble.Model)  # -> Model, Mass_kg, Area_m², Volume_m³, Meshes
analyse = AnalyseKaramba3D(Model=assemble.Model)  # -> AnalysedModel, MaximumDisplacement_cm, ResultingForce_kN, ChangeOfElasticEnergy_kNm
emodes = EigenModesKaramba3D(
    Model=analyse.AnalysedModel,
    FromIndex=1,
    NumberOfModes=1,
    WithThIIEffects=True,
    MaximumNumberOfIterations=300,
    Epsilon=1e-07)  # -> ModelWithEigenModes, Eigenvalues
disassemble = DisassembleModelKaramba3D(Model=analyse.AnalysedModel)  # -> Model, Point, Beam, Shell, Support, Load, Line, Mesh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
disassemble_2 = DisassembleElementKaramba3D(Element=disassemble.Shell)  # -> Element, ElementIdentifier, AxisOfElement, simplify(graft(CrossSection)), Joint, simplify(graft(Material)), LocalCoordinateSystem, ElementIsActive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
modelview = ModelViewKaramba3D(Model=analyse.AnalysedModel)  # -> Model, DeformedMesh, DeformedAxes, DeformedModel, MaximumDeformation
s_forces = ShellForcesKaramba3D(AnalysedModel=analyse.AnalysedModel, mode="Principal")  # -> Model, FirstPrincipalNormalForce_kN_m, SecondPrincipalNormalForce_kN_m, FirstPrincipalMoment_kNm_m, SecondPrincipalMoment_kNm_m, ShearForceInLocalXDirection_kN_m, ShearForceInLocalYDirection_kN_m, LoadCaseIndex
shellview = ShellViewKaramba3D(Model=modelview.Model, IndexOfLayer=0)  # -> Model, MeshesOfRenderedShells, LegendColours, LegendTags
s_forces_2 = ShellSectionKaramba3D(
    Model=shellview.Model,
    IntersectionGeometry=geo,
    ProjectionDirection=Vector(0, 0, -1),
    mode="Forces",
    menu=[checkbox(on), checkbox(on), checkbox(on), slider(15), slider(0.1), slider(0.13), checkbox(off), checkbox(off), checkbox(off), checkbox(on), checkbox(off), checkbox(off), checkbox(off), checkbox(off), checkbox(on), slider(1.15)])  # -> Model, CuttingCurves, FaceIndices, MeshesOfRenderedResults, CurvesOfRenderedResults, Ntt_kN_m, Nnn_kN_m, Ntn_kN_m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
utilization = UtilizationOfElementsKaramba3D(
    AnalysedModel=s_forces_2.Model,
    NumberOfSamplePoints=3,
    ElasticDesign=True,
    GammaM0=1,
    GammaM1=1.1,
    SwayFrame=True,
    WithDetails=False,
    mode="Beams")  # -> Model, Utilization, SigMax_kN_cm², SigMin_kN_cm², TauMax_kN_cm², UtilN, UtilVy, UtilVz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
extremes = MinMax(Number=flatten(utilization.Utilization))  # -> Minimum, Maximum
num = Number(extremes.Maximum)

# ----
# Speckle Setup
conparts = ConnectedPartsKaramba3D(Model=analyse.AnalysedModel)  # -> ConnectedLines, ConnectedMeshes
entwine_2 = Entwine(Branch00=conparts.ConnectedMeshes, Branch01=conparts.ConnectedLines, FlattenInputs=True)
panel_5 = Panel("""area
thickness""")
bang = ExplodeTree(Data=entwine_2)  # -> Branch0, Branch1
esokv = ExtendSpeckleObjectByKeyValue(SpeckleObject=bang.Branch0, Keys=panel_5, Values=[area, thickness], selectedKitName="Objects")
cso = CreateSpeckleObject(Member=[esokv, bang.Branch1], Key=panel_4, selectedKitName="Objects")
csokv = CreateSpeckleObjectByKeyValue(Keys="Utilization", Values=num, selectedKitName="Objects")

# ----
# Speckle Synchronous Sender for Rhino.Compute
speckle_token = GetString(AtLeast=1, AtMost=1, TreeAccess=False)
project_url = GetString(AtLeast=1, AtMost=1, TreeAccess=False)
sgetwt = StreamGetWithToken(Stream=project_url, AuthToken=speckle_token)
ss = SynchronousSender(
    Data=[cso, csokv],
    Stream=sgetwt,
    OutputWrappers="https://app.speckle.systems\t791d494b2e\t0376ff8072",
    UseDefaultCache=True,
    selectedKitName="Objects")
txt = Text(ss)
context_print = ContextPrint(Text=txt)

# ----
# Conventional Sender for Speckle
panel_6 = Panel("https://app.speckle.systems/projects/791d494b2e/models/243b213475")
send = Send(
    Stream=panel_6,
    Members=cso,
    AutoSend=False,
    BaseId="1d8c39581096acfd38f1b4cf0387c822",
    CurrentComponentState="up_to_date",
    KitName="Objects",
    OutputWrappers="https://app.speckle.systems\t791d494b2e\tf38f0fe0eb",
    UseDefaultCache=True,
    selectedKitName="Objects")  # disabled
